# Grasshopper definition StochasticDensitySampling.gh (Grasshopper 1.0.7)
# plug-ins: Human, LunchBox

curve_attractor = Curve(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)  # disabled
# 1.4
curve_attractor_2 = Region({Plane=PlaneXY(0, 0, 0), X=Domain(0, 10), Y=Domain(0, 10), Z=Domain(0, 2)})  # disabled

count_pop_3d = Slider(3000, range=1..4000)  # disabled
# changing the order by changing the distance adding random values to it
# ディフォルトだともとの数が少ない方が残る分布は広範囲になる
number_slider = Slider(1, range=0..1)  # disabled
crv = Curve(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)  # disabled
region = Region({Plane=PlaneXY(0, 0, 0), X=Domain(0, 10), Y=Domain(0, 10), Z=Domain(0, 2)})  # disabled
seed = Slider(70, range=0..100)  # disabled
crv_2 = Curve(crv)  # disabled
count_culling = Slider(400, range=1..3000)
pop3d = Populate3D(Region=region, Count=count_pop_3d, Seed=seed)
dom = ConstructDomain(DomainStart=expr("x*-1", number_slider), DomainEnd=number_slider)
pt = Point(pop3d)
lng = ListLength(List=pop3d)
crv_cp = CurveClosestPoint(Point=pt, Curve=crv_2)  # -> Point, Parameter, Distance
bnd = Bounds(Numbers=crv_cp.Distance)
random = Random(Range=dom, Number=lng, Seed=2)
dedomain = DeconstructDomain(Domain=bnd)  # -> Start, End
multiplication = Multiplication(A=random, B=dedomain.End)
addition = Addition(A=multiplication, B=crv_cp.Distance)
sort = SortList(Keys=addition, ValuesA=pt)  # -> Keys, ValuesA
subset = SubList(List=sort.ValuesA, Domain=count_culling, Wrap=True)  # -> List, Index
voronoi³ = Voronoi3D(Points=subset.List, Box=region)  # -> Cells, Boundary

# ----
# 1.1
# Sharp Subset Culling
# 1
# Sort+SubSet
count_pop_3d_2 = Slider(4000, range=1..4000)  # disabled
# Shuffle Subset Culling (Jitter)
# changing the order by shuffling indecies
count_pop_3d_3 = Slider(1000, range=1..4000)  # disabled
seed_2 = Slider(39, range=0..100)  # disabled
seed_3 = Slider(39, range=0..100)  # disabled
# SDS Stochastic Density Sampling by Chie Fuyuki
# 2025.1.11
region_2 = Region({Plane=PlaneXY(0, 0, 0), X=Domain(0, 10), Y=Domain(0, 10), Z=Domain(0, 2)})  # disabled
crv_3 = Curve(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)  # disabled
region_3 = Region({Plane=PlaneXY(0, 0, 0), X=Domain(0, 10), Y=Domain(0, 10), Z=Domain(0, 2)})  # disabled
pop3d_2 = Populate3D(Region=region_2, Count=count_pop_3d_2, Seed=seed_2)
pop3d_3 = Populate3D(Region=region_3, Count=count_pop_3d_3, Seed=seed_3)
pt_2 = Point(pop3d_2)

# ----
# 1.2
count_culling_2 = Slider(400, range=1..3000)  # disabled
crv_4 = Curve(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)  # disabled
crv_cp_2 = CurveClosestPoint(Point=pt_2, Curve=crv_4)  # -> Point, Parameter, Distance
sort_2 = SortList(Keys=crv_cp_2.Distance, ValuesA=pt_2)  # -> Keys, ValuesA
subset_2 = SubList(List=sort_2.ValuesA, Domain=count_culling_2, Wrap=True)  # -> List, Index
sort_pts = SortDuplicatePoints(Points=subset_2.List)  # -> UniquePoints, Indices
voronoi³_2 = Voronoi3D(Points=sort_pts.UniquePoints, Box=region_2)  # -> Cells, Boundary

pt_3 = Point(pop3d_3)
wires = BrepWireframe(Brep=voronoi³_2.Cells, Density=-1)
preview = CustomPreview(Geometry=voronoi³_2.Cells, Material=ColourSwatch(SwatchColor=RGB(255, 255, 255)))
wires_2 = BrepWireframe(Brep=voronoi³.Cells, Density=-1)
preview_2 = CustomPreview(Geometry=voronoi³.Cells, Material=ColourSwatch(SwatchColor=RGB(255, 255, 255)))
previewlw = CustomPreviewLineweights(Geometry=wires, Shader=ColourSwatch(SwatchColor=RGB(0, 0, 0)), Thickness=Slider(1, range=0..10), Absolute=False)
previewlw_2 = CustomPreviewLineweights(Geometry=wires_2, Shader=ColourSwatch(SwatchColor=RGB(0, 0, 0)), Thickness=Slider(1, range=0..10), Absolute=False)
Z = UnitZ(Factor=Slider(2, range=0..10))
number_slider_2 = Slider(2, range=0..10)  # disabled
swatch = ColourSwatch(SwatchColor=RGBA(255, 255, 255, 200))  # disabled
swatch_2 = ColourSwatch(SwatchColor=RGB(0, 0, 0))  # disabled

# ----
# Rnadom Weighted Subset Culling (Adding Random Values with Spatial Tendency)
# the closer x (the dist value) is y is the smaller, enhacising it
region_4 = Region(curve_attractor_2)  # disabled
count_pop_3d_4 = Slider(2000, range=1..6000)  # disabled
count_culling_3 = Slider(400, range=1..3000)  # disabled
seed_4 = Slider(70, range=0..100)  # disabled
crv_5 = Curve(curve_attractor)  # disabled
pop3d_4 = Populate3D(Region=region_4, Count=count_pop_3d_4, Seed=seed_4)
pt_4 = Point(pop3d_4)
crv_cp_3 = CurveClosestPoint(Point=pt_4, Curve=crv_5)  # -> Point, Parameter, Distance
bnd_2 = Bounds(Numbers=crv_cp_3.Distance)
lng_2 = ListLength(List=pop3d_4)
random_2 = Random(Range=Domain(0, 1), Number=lng_2, Seed=2)

remap = RemapNumbers(Value=crv_cp_3.Distance, Source=bnd_2, Target=Domain(0, 1))  # -> Mapped, Clipped

# ----
# Random Subset Culling (Adding Random Values)
# 1.3
count_culling_4 = Slider(800, range=1..3000)  # disabled
number_slider_3 = Slider(0.387, range=0..1)  # disabled
crv_cp_4 = CurveClosestPoint(Point=pt_3, Curve=crv_3)  # -> Point, Parameter, Distance
sort_3 = SortList(Keys=crv_cp_4.Distance, ValuesA=pt_3)  # -> Keys, ValuesA

jitter = Jitter(List=sort_3.ValuesA, Jitter=number_slider_3, Seed=2)  # -> Values, Indices

subset_3 = SubList(List=jitter.Values, Domain=count_culling_4, Wrap=True)  # -> List, Index
voronoi³_3 = Voronoi3D(Points=subset_3.List, Box=region_3)  # -> Cells, Boundary

wires_3 = BrepWireframe(Brep=voronoi³_3.Cells, Density=-1)
preview_3 = CustomPreview(Geometry=voronoi³_3.Cells, Material=ColourSwatch(SwatchColor=RGB(255, 255, 255)))
previewlw_3 = CustomPreviewLineweights(Geometry=wires_3, Shader=ColourSwatch(SwatchColor=RGB(0, 0, 0)), Thickness=Slider(1, range=0..10), Absolute=False)

graph_ver3 = GraphMapper(
    remap.Mapped,
    x0=0,
    x1=1,
    y0=0,
    y1=1,
    container_name="Bezier",
    cpx=[0, 0.3493559361, 0, 1],
    cpy=[0, 1, 0.8785225749, 0.9603302479])

addition_2 = Addition(A=random_2, B=graph_ver3)

sort_4 = SortList(Keys=addition_2, ValuesA=pt_4)  # -> Keys, ValuesA
subset_4 = SubList(List=sort_4.ValuesA, Domain=count_culling_3, Wrap=True)  # -> List, Index
voronoi³_4 = Voronoi3D(Points=subset_4.List, Box=region_4)  # -> Cells, Boundary

preview_4 = CustomPreview(Geometry=voronoi³_4.Cells, Material=ColourSwatch(SwatchColor=RGB(255, 255, 255)))
wires_4 = BrepWireframe(Brep=voronoi³_4.Cells, Density=-1)
num = Number(expr("round(x,3)", addition_2))
move = Move(Geometry=subset_4.List, Motion=Z)  # -> Geometry, Transform
tag = TextTag3D(Location=move.Geometry, Text=num, Size=Slider(0.1, range=0..1), Justification=7)
previewlw_4 = CustomPreviewLineweights(Geometry=wires_4, Shader=ColourSwatch(SwatchColor=RGB(0, 0, 0)), Thickness=Slider(1, range=0..10), Absolute=False)

# ----
# Step1
# 2.2
# Random < Probability
number_slider_4 = Slider(171, range=0..1000)
count_pop_3d_5 = Slider(3190, range=0..10000)
curve_attractor_3 = Curve(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)
region_5 = Region({Plane=PlaneXY(0, 0, 0), X=Domain(0, 10), Y=Domain(0, 10), Z=Domain(0, 2)})
pop3d_5 = Populate3D(Region=region_5, Count=count_pop_3d_5, Seed=number_slider_4)
random_3 = Random(Range="0 to 1", Number=count_pop_3d_5, Seed=Slider(600, range=0..1000))

pt_5 = Point(pop3d_5)

pull = PullPoint(Point=pt_5, Geometry=curve_attractor_3, ClosestOnly=True)  # -> ClosestPoint, Distance
bnd_3 = Bounds(Numbers=pull.Distance)
remap_2 = RemapNumbers(Value=pull.Distance, Source=bnd_3, Target=Domain(0, 1))  # -> Mapped, Clipped
graph_ver3_2 = GraphMapper(
    remap_2.Mapped,
    x0=0,
    x1=1,
    y0=0,
    y1=1,
    container_name="Bezier",
    cpx=[0, 0, 0.1933576018, 1],
    cpy=[1, 0.08193278313, 0, 0])
num_2 = Number(simplify(graph_ver3_2))
smaller = SmallerThan(FirstNumber=random_3, SecondNumber=num_2)  # -> SmallerThan, OrEqualTo
cull = CullPattern(List=pt_5, CullPattern=simplify(smaller.SmallerThan))
voronoi³_5 = Voronoi3D(Points=cull)  # -> Cells, Boundary

# ----
# Step2
number_slider_5 = Slider(1, range=0..10)
debrep = DeconstructBrep(Brep=region_5)  # -> Faces, Edges, Vertices
volume = Volume(Geometry=voronoi³_5.Cells)  # -> Volume, Centroid
merge = Merge(Data1=curve_attractor_3, Data2=debrep.Edges)  # -> flatten(Result)
pull_2 = PullPoint(Point=volume.Centroid, Geometry=merge, ClosestOnly=True)  # -> ClosestPoint, Distance
larger = LargerThan(FirstNumber=pull_2.Distance, SecondNumber=number_slider_5)  # -> LargerThan, OrEqualTo
cull_2 = CullPattern(List=voronoi³_5.Cells, CullPattern=simplify(larger.LargerThan))

wires_5 = BrepWireframe(Brep=voronoi³_5.Cells, Density=-1)  # -> simplify(Wireframe); disabled
preview_5 = CustomPreview(Geometry=voronoi³_5.Cells, Material=swatch)  # disabled
previewlw_5 = CustomPreviewLineweights(Geometry=wires_5, Shader=swatch_2, Thickness=number_slider_2, Absolute=False)  # disabled
wires_6 = BrepWireframe(Brep=cull_2, Density=-1)
preview_6 = CustomPreview(Geometry=cull_2, Material=ColourSwatch(SwatchColor=RGBA(255, 255, 255, 183)))
previewlw_6 = CustomPreviewLineweights(Geometry=wires_6, Shader=ColourSwatch(SwatchColor=RGB(0, 0, 0)), Thickness=Slider(2, range=0..10), Absolute=False)

# ----
# Step1
count_pop_3d_6 = Slider(3000, range=0..6000)
# 2.1
# Probability < Random
# * Logic Inversion:
# Applied $P < R$
# for Graph Mapper compatibility
#  with Method 1.4.
number_slider_6 = Slider(200, range=0..1000)  # disabled
curve_attractor_4 = Curve(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)  # disabled
region_6 = Region({Plane=PlaneXY(0, 0, 0), X=Domain(0, 10), Y=Domain(0, 10), Z=Domain(0, 2)})  # disabled
pop3d_6 = Populate3D(Region=region_6, Count=count_pop_3d_6, Seed=number_slider_6)
random_4 = Random(Range="0 to 1", Number=count_pop_3d_6, Seed=Slider(600, range=0..1000))

pt_6 = Point(pop3d_6)

pull_3 = PullPoint(Point=pt_6, Geometry=curve_attractor_4, ClosestOnly=True)  # -> ClosestPoint, Distance
bnd_4 = Bounds(Numbers=pull_3.Distance)
remap_3 = RemapNumbers(Value=pull_3.Distance, Source=bnd_4, Target=Domain(0, 1))  # -> Mapped, Clipped
num_3 = Number(simplify(remap_3.Mapped))
smaller_2 = SmallerThan(FirstNumber=num_3, SecondNumber=random_4)  # -> SmallerThan, OrEqualTo
cull_3 = CullPattern(List=pt_6, CullPattern=simplify(smaller_2.SmallerThan))
voronoi³_6 = Voronoi3D(Points=cull_3)  # -> Cells, Boundary

wires_7 = BrepWireframe(Brep=voronoi³_6.Cells, Density=-1)  # -> simplify(Wireframe)
preview_7 = CustomPreview(Geometry=voronoi³_6.Cells, Material=ColourSwatch(SwatchColor=RGBA(255, 255, 255, 61)))  # disabled
previewlw_7 = CustomPreviewLineweights(Geometry=wires_7, Shader=ColourSwatch(SwatchColor=RGB(0, 0, 0)), Thickness=Slider(2, range=0..10), Absolute=False)  # disabled

# ----
# Step1
count_pop_3d_7 = Slider(2000, range=0..6000)
# 2.2
# Probability < Random
# * Logic Inversion:
# Applied $P < R$
# for Graph Mapper compatibility
#  with Method 1.4.
number_slider_7 = Slider(200, range=0..1000)  # disabled
curve_attractor_5 = Curve(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)  # disabled
region_7 = Region({Plane=PlaneXY(0, 0, 0), X=Domain(0, 10), Y=Domain(0, 10), Z=Domain(0, 2)})  # disabled
pop3d_7 = Populate3D(Region=region_7, Count=count_pop_3d_7, Seed=number_slider_7)
random_5 = Random(Range="0 to 1", Number=count_pop_3d_7, Seed=Slider(600, range=0..1000))

pt_7 = Point(pop3d_7)

pull_4 = PullPoint(Point=pt_7, Geometry=curve_attractor_5, ClosestOnly=True)  # -> ClosestPoint, Distance
bnd_5 = Bounds(Numbers=pull_4.Distance)
remap_4 = RemapNumbers(Value=pull_4.Distance, Source=bnd_5, Target=Domain(0, 1))  # -> Mapped, Clipped
graph_ver3_3 = GraphMapper(
    remap_4.Mapped,
    x0=0,
    x1=1,
    y0=0,
    y1=1,
    container_name="Bezier",
    cpx=[0, 0.3493559361, 0, 1],
    cpy=[0, 1, 0.8785225749, 0.9603302479])
num_4 = Number(simplify(graph_ver3_3))
smaller_3 = SmallerThan(FirstNumber=num_4, SecondNumber=random_5)  # -> SmallerThan, OrEqualTo
cull_4 = CullPattern(List=pt_7, CullPattern=simplify(smaller_3.SmallerThan))
voronoi³_7 = Voronoi3D(Points=cull_4)  # -> Cells, Boundary

wires_8 = BrepWireframe(Brep=voronoi³_7.Cells, Density=-1)  # -> simplify(Wireframe)
preview_8 = CustomPreview(Geometry=voronoi³_7.Cells, Material=ColourSwatch(SwatchColor=RGBA(255, 255, 255, 61)))  # disabled
previewlw_8 = CustomPreviewLineweights(Geometry=wires_8, Shader=ColourSwatch(SwatchColor=RGB(0, 0, 0)), Thickness=Slider(2, range=0..10), Absolute=False)  # disabled
